# Dynamo graph instanceToType.dyn (Dynamo 1.3.4.6666)

familyParameters = Custom[FamilyDocument.FamilyParameters]()  # Retrieves all family parameters from the active family document. PLEASE NOTE: This node will only work in a family document!
name = Custom[Element.Name+](element=familyParameters)  # Gets an element's name. Unlike the OOTB node, this node should work for all Revit elements that have names and will also return the localized names of system parameters, parameter groups, display unit types, parameter types, unit symbol types and unit types.
code_block = CodeBlock { {"2rw_Type", "2rw_Abbrv", "2rw Mark"}; }
python_script = Python(IN[0]=familyParameters, IN[1]=name, IN[2]=code_block)
# ---------- python_script.python (11 lines) ----------
import clr
clr.AddReference('ProtoGeometry')
from Autodesk.DesignScript.Geometry import *

matches = []

for i in range(0, len(IN[2])):
	for j in range(0, len(IN[1])):
		if(IN[2][i] == IN[1][j]): matches.append(IN[0][j])

OUT = matches
# ----------------------------------------
makeType = Custom[FamilyParameter.MakeType](familyParameter=python_script)  # Converts an instance parameter to a type parameter. ATTENTION: Only works in a family document.
