# Dynamo graph setFamilyParam18-2.dyn (Dynamo 1.3.4.6666)

family_types = FamilyTypes("M-AHU MZ_AnnexAir (AHU-2):AHU-2 (14,700 SA CFM, 7,350 EA CFM)")
all_elements_of_family_type = ElementsOfFamilyType(family_types)
type = FamilyInstance.Type(all_elements_of_family_type)
create = List.Create(all_elements_of_family_type, type)
setParameterByName = Element.SetParameterByName(element=create)  # unwired: parameterName, value
code_block = CodeBlock()
# ---------- code_block.designscript (2 lines) ----------
{"Design ER Summer Exhaust Entering Air DB Temperature", "Design ER Summer Exhaust Entering Air WB Temperature"};
{1.17148935246489, 1.10636681355417};
# ----------------------------------------
combine = List.Combine(setParameterByName, code_block.out0, code_block.out1)
